# Grasshopper definition Example_Lattice_Beam_Analysis.gh (Grasshopper 1.0.8)
# plug-ins: FEA_Beam_Solver

# ---- group: Increase deformation multiplier here
number_slider = Slider(0.034, range=0.001..1.001)

# ----
add_support_points_here = Point([<point referenced from the Rhino model> x4])
add_lattice_curves_here = Curve([<curve referenced from the Rhino model> x333])

# ---- group: Loads right now are -2kN will update later
add_point_loads_point = Point([<point referenced from the Rhino model> x9])

# ----
beam_fea = BeamFEA(
    Beams=add_lattice_curves_here,
    Loads=add_point_loads_point,
    Supports=add_support_points_here,
    Metric=Slider(2, range=0..3),
    DeformScale=number_slider)  # -> Result, Dots, Curves, Values, DispVectors, NodeDispMag, DeformedCurves
curve = Curve(beam_fea.DeformedCurves)
panel = Panel(beam_fea.Result)
annotation_dot = AnnotationDot(beam_fea.Dots)
bounds = Bounds(Numbers=beam_fea.Values)
deconstruct_domain = DeconstructDomain(Domain=bounds)  # -> Start, End
gradient = Gradient(
    LowerLimit=deconstruct_domain.Start,
    UpperLimit=deconstruct_domain.End,
    Parameter=beam_fea.Values,
    stops=[0: RGB(255, 130, 160), 0.612: RGB(220, 0, 40)])
custom_preview = CustomPreview(Geometry=curve, Material=gradient)
